# Grasshopper definition Kinect robot simulation TEST.gh (Grasshopper 1.0.7)
# plug-ins: Firefly.Kinect.V1

kinect_v1_color_stream = KinectV1ColorStream()
kinect_v1_skeletal_tracker = KinectV1SkeletalTracker(
    StartSkeletonTracker=Toggle(False),
    SkeletonScaleFactor=Slider(690, range=0..1200),
    TranslateInZAxis=0,
    TimerIntervalInMillisecondsForUpdatingEvents=5)  # -> Points, JointID, Bones
number_slider = Slider(90, range=0..360)
unit_z = UnitZ(Factor=1)
rotate_3d = Rotate3D(Geometry=kinect_v1_skeletal_tracker.Bones, Angle=degrees(number_slider), Center=Point(0, 0, 0), Axis=unit_z)  # -> Geometry, Transform
rotate_3d_2 = Rotate3D(Geometry=kinect_v1_skeletal_tracker.Points, Angle=degrees(number_slider), Center=Point(0, 0, 0), Axis=unit_z)  # -> Geometry, Transform
vector_xyz = VectorXYZ(
    XComponent=Slider(1606, range=-3000..3000),
    YComponent=Slider(30, range=-3000..3000),
    ZComponent=Slider(500, range=-3000..3000))  # -> Vector, Length
move = Move(Geometry=rotate_3d_2.Geometry, Motion=vector_xyz.Vector)  # -> Geometry, Transform
move_2 = Move(Geometry=rotate_3d.Geometry, Motion=vector_xyz.Vector)  # -> Geometry, Transform
pipe = Pipe(Curve=move_2.Geometry, Radius=Slider(28, range=0..30), Caps=Slider(2, range=0..2))  # -> flatten(Pipe)
list_item = ListItem(List=move.Geometry, Index=Slider(3, range=0..18), Wrap=True)
list_item_2 = ListItem(List=pipe, Index=Slider(14, range=0..18), Wrap=True)
sphere = Sphere(Base=list_item, Radius=Slider(67, range=0..120))
deconstruct_brep = DeconstructBrep(Brep=list_item_2)  # -> Faces, Edges, Vertices
list_item_3 = ListItem(List=deconstruct_brep.Faces, Index=Slider(8, range=0..18), Wrap=True)
list_item_4 = ListItem(List=deconstruct_brep.Vertices, Index=Slider(11, range=0..18), Wrap=True)
custom_preview = CustomPreview(Geometry=[sphere, pipe], Material=ColourSwatch(SwatchColor=RGB(49, 120, 145)))
plane = Plane(list_item_3)
data_dam = DataDam(DataDataA=plane, BufferDelay=5000000, BufferMode=2)
rr_framestype = Integer(0)
rr_rxoffset = Integer(0)
rr_ryoffset = Integer(0)
rr_rzoffset = Integer(0)
rr_curves = Curve()
rr_points = Point(data_dam)
rr_mesh = Mesh()
rr_kinks = Boolean(True)
rr_lbf = Integer(50)
rr_file = FilePath()
frames = Frames(
    rr_curves=rr_curves,
    rr_mesh=rr_mesh,
    rr_points=rr_points,
    rr_framestype=rr_framestype,
    rr_lbf=rr_lbf,
    rr_kinks=rr_kinks,
    rr_rxoffset=rr_rxoffset,
    rr_ryoffset=rr_ryoffset,
    rr_rzoffset=rr_rzoffset,
    rr_file=rr_file)  # -> color_2, T
rr_filepath = Text("C:\RhinoRobot\prog.pjx")
rr_targets = Plane(frames.T)
rr_round = Number(10)
rr_export = Boolean(False)
rr_colors = Text(frames.color_2)
rr_e1 = Number(0)
rr_e2 = Number(0)
rr_acc = Number(100)
rr_vel = Number(400)
program = Program(
    rr_colors=rr_colors,
    rr_targets=rr_targets,
    rr_e1=rr_e1,
    rr_e2=rr_e2,
    rr_acc=rr_acc,
    rr_vel=rr_vel,
    rr_round=rr_round,
    rr_filepath=rr_filepath,
    rr_export=rr_export)

# ==== cluster Program
rr_colors = ClusterInput()
rr_targets = ClusterInput()
rr_e1 = ClusterInput()
rr_e2 = ClusterInput()
rr_acc = ClusterInput()
rr_vel = ClusterInput()
rr_round = ClusterInput()
rr_filepath = ClusterInput()
rr_export = ClusterInput()
rr_colors_2 = Text(simplify(graft(rr_colors)))
rr_targets_2 = Plane(rr_targets)
rr_e1_2 = Number(rr_e1)
rr_e2_2 = Number(rr_e2)
rr_filepath_2 = Text(rr_filepath)
rr_export_2 = Boolean(rr_export)
rr_acc_2 = Number(rr_acc)
rr_vel_2 = Number(rr_vel)
rr_round_2 = Number(rr_round)

panel = Panel("          <Value key=\"{0}\" x=\"{1:0.000}\" y=\"{2:0.000}\" z=\"{3:0.000}\" rx=\"{4:0.000}\" ry=\"{5:0.000}\" rz=\"{6:0.000}\" fatherId=\"{7}\" />")
lng = ListLength(List=rr_targets_2)
panel_2 = Panel("""    <Data name="p_{4}_{0}" access="private" xsi:type="array" type="pointRx" size="{3}">
{1}    </Data>""")
series = Series(Start=0, Step=1, Count=lng)  # -> simplify(Series)
int = Integer(series)
folder = CSharpScript(Go=rr_export_2, filepath=rr_filepath_2)  # -> out, GoNext, Folder, Name; inputs Go: Boolean, filepath: String
# ---------- folder: C# usings ----------
using System.IO;
using System.Linq;
using System.Data;
using System.Drawing;
using System.Reflection;
using System.Windows.Forms;
using System.Xml;
using System.Xml.Linq;
using System.Runtime.InteropServices;

using Rhino.DocObjects;
using Rhino.Collections;
using GH_IO;
using GH_IO.Serialization;
# ---------- folder: C# ----------
    Folder = Path.GetDirectoryName(filepath);
    Name = Path.GetFileNameWithoutExtension(filepath);
    if (Go)
    {
      GoNext = Go;
    }
# ---------- end folder ----------
rr_calc = RhinoRobotCalculation(RR_Targets=rr_targets_2, Convention="0", RR_CPlaneName="RR_Base")  # -> X, Y, Z, ThetaX, ThetaY, ThetaZ, ThetaX0, ThetaX1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
framename = Panel("frame1[0]")
format = Format(
    Format=panel,
    Culture=127,
    Data0=int,
    Data1=rr_calc.X,
    Data2=rr_calc.Y,
    Data3=rr_calc.Z,
    Data4=rr_calc.ThetaX,
    Data5=rr_calc.ThetaY,
    Data6=rr_calc.ThetaZ,
    Data7=framename)
vb = VBScript(tree=rr_targets_2)  # -> out, struct; inputs tree: tree
# ---------- vb: VB ----------
    Dim structlist As New DataTree(Of String)
    For i As Integer = 0 To tree.BranchCount - 1
      Dim pth = New GH_Path(i)
      structlist.add(i, pth)
      Next
    struct = structlist
# ---------- end vb ----------
join = TextJoin(Text=format)
format_2 = Format(Format=panel_2, Culture=127, Data0=vb.struct, Data1=join, Data2=framename, Data3=lng, Data4=folder.Name)  # -> simplify(Text)

# ---- group: prog.dtx
param = Panel("""    <Data name="mdesc1" access="public" xsi:type="array" type="mdesc" size="1">
      <Value key="0" accel="{0}" vel="50" decel="{0}" tmax="{1}"  blend="cartesian" reach="{2}" leave="{2}"/>
    </Data>""")
format_3 = Format(Format=param, Culture=127, Data0=rr_acc_2, Data1=rr_vel_2, Data2=rr_round_2)  # -> flatten(Text)
base = Panel("""    <Data name="frame1" access="public" xsi:type="array" type="frame" size="1">
      <Value key="0" x="0" y="0" z="0" rx="0" ry="0" rz="0" fatherId="world[0]" />
    </Data>""")
tool = Panel("""    <Data name="tool1" access="public" xsi:type="array" type="tool" size="1">
      <Value key="0" x="0" y="0" z="0" rx="0" ry="0" rz="0" fatherId="flange[0]" />
    </Data>""")
start = Panel("""<?xml version="1.0" encoding="utf-8"?>
<Database xmlns:xsi="http://www.w3.org/2001/XMLSchema-instance" xmlns="http://www.staubli.com/robotics/VAL3/Data/2">
  <Datas>""")
home = Panel("""    <Data name="phome" access="private" xsi:type="array" type="jointRx" size="1">
      <Value key="0" j1="0" j2="0" j3="90" j4="0" j5="45" j6="0" />
    </Data>""")
end = Panel("""  </Datas>
</Database>""")
filename = Panel(".dtx")
merge = Merge(Data1=folder.Folder, Data2="\", Data3=folder.Name, Data4="\", Data5=folder.Name, Data6=filename)
merge_2 = Merge(Data1=start, Data2=base, Data3=tool, Data4=home, Data5=format_3, Data6=flatten(format_2), Data7=end)  # -> flatten(Result)
join_2 = TextJoin(Text=merge)
join_3 = TextJoin(Text=merge_2)
c_script = CSharpScript(Data=join_3, Write=folder.GoNext, FilePath=join_2)  # inputs Data: String, Write: Boolean, FilePath: String
# ---------- c_script: C# ----------
    if (Write)
    {
      string directoryName = Path.GetDirectoryName(FilePath);
      Directory.CreateDirectory(directoryName);
      File.WriteAllText(FilePath, Data);
    }
# ---------- end c_script ----------

# ---- group: prog.pgx
syntax = Panel("""    // Traj{1}
    {0}
    for i=0 to {3}
    movel(p_{4}_{1}[i],tool1[0],mdesc1[0])
    endFor
    {2}""")
lng_2 = ListLength(List=flatten(rr_colors_2))
vb_2 = VBScript(x="//Start", y="//Stop", z=rr_colors_2)  # -> out, A, B
# ---------- vb_2: VB ----------
    If z = "Black" Then
      A = x
      B = y
    Else
      A = ""
      B = ""
    End If
# ---------- end vb_2 ----------
lng_3 = ListLength(List=rr_targets_2)  # -> expr("x-1", Length)
series_2 = Series(Start=0, Step=1, Count=lng_2)  # -> simplify(graft(Series))
format_4 = Format(Format=syntax, Culture=127, Data0=vb_2.A, Data1=series_2, Data2=vb_2.B, Data3=lng_3, Data4=folder.Name)  # -> flatten(Text)
join_4 = TextJoin(Text=format_4)
start_2 = Panel("""" access="public" >
    <Locals>
      <Local name="i" type="num" xsi:type="array" size="1" />
    </Locals>
    <Code>
    <![CDATA[begin
    resetMotion()
    movej(phome[0],tool1[0],mdesc1[0])""")
filename_2 = Panel(".pgx")
start_3 = Panel("""<?xml version="1.0" encoding="utf-8" ?>
<Programs xmlns:xsi="http://www.w3.org/2001/XMLSchema-instance" xmlns="http://www.staubli.com/robotics/VAL3/Program/2" >
  <Program name="
""")
end_2 = Panel("""    movej(phome[0],tool1[0],mdesc1[0])
    waitEndMove()
    end]]>
    </Code>
  </Program>
</Programs>""")
merge_3 = Merge(Data1=folder.Folder, Data2="\", Data3=folder.Name, Data4="\", Data5=folder.Name, Data6=filename_2)
merge_4 = Merge(Data1=start_3, Data2=folder.Name, Data3=start_2, Data4=join_4, Data5=end_2)  # -> flatten(Result)
join_5 = TextJoin(Text=merge_3)
join_6 = TextJoin(Text=merge_4)
c_script_2 = CSharpScript(Data=join_6, Write=folder.GoNext, FilePath=join_5)  # inputs Data: String, Write: Boolean, FilePath: String; same code as c_script

# ---- group: start.pgx
start_pgx = Panel("""<?xml version="1.0" encoding="utf-8"?>
<Programs xmlns:xsi="http://www.w3.org/2001/XMLSchema-instance" xmlns="http://www.staubli.com/robotics/VAL3/Program/2">
  <Program name="start" access="public">
    <Code><![CDATA[
        begin
          resetMotion()
          call """)
start_pgx_2 = Panel(""" ()
        end
      ]]></Code>
  </Program>
</Programs>""")
merge_5 = Merge(Data1=start_pgx, Data2=folder.Name, Data3=start_pgx_2)
filename_3 = Panel("\start.pgx")
merge_6 = Merge(Data1=folder.Folder, Data2="\", Data3=folder.Name, Data4=filename_3)
join_7 = TextJoin(Text=merge_5)
join_8 = TextJoin(Text=merge_6)
c_script_3 = CSharpScript(Data=join_7, Write=folder.GoNext, FilePath=join_8)  # inputs Data: String, Write: Boolean, FilePath: String; same code as c_script

# ---- group: prog.pjx
start_4 = Panel("""<?xml version="1.0" encoding="utf-8"?>
<Project xmlns="http://www.staubli.com/robotics/VAL3/Project/3">
  <Parameters version="s7.5.4" stackSize="5000" millimeterUnit="true" />
  <Programs>
    <Program file="start.pgx" />
    <Program file="
""")
end_3 = Panel(""".dtx" />
  </Database>
</Project>""")
panel_3 = Panel(""".pgx" />
    <Program file="stop.pgx" />
  </Programs>
  <Database>
    <Data file="
""")
filename_4 = Panel(".pjx")
merge_7 = Merge(Data1=start_4, Data2=folder.Name, Data3=panel_3, Data4=folder.Name, Data5=end_3)  # -> flatten(Result)
merge_8 = Merge(Data1=folder.Folder, Data2="\", Data3=folder.Name, Data4="\", Data5=folder.Name, Data6=filename_4)
join_9 = TextJoin(Text=merge_7)
join_10 = TextJoin(Text=merge_8)
c_script_4 = CSharpScript(Data=join_9, Write=folder.GoNext, FilePath=join_10)  # inputs Data: String, Write: Boolean, FilePath: String; same code as c_script

# ---- group: stop.pgx
filename_5 = Panel("\stop.pgx")
merge_9 = Merge(Data1=folder.Folder, Data2="\", Data3=folder.Name, Data4=filename_5)
stop_pgx = Panel("""<?xml version="1.0" encoding="utf-8"?>
<Programs xmlns:xsi="http://www.w3.org/2001/XMLSchema-instance" xmlns="http://www.staubli.com/robotics/VAL3/Program/2">
  <Program name="stop" access="public">
    <Code><![CDATA[
        begin
          resetMotion()
        end
      ]]></Code>
  </Program>
</Programs>""")
join_11 = TextJoin(Text=merge_9)
c_script_5 = CSharpScript(Data=stop_pgx, Write=folder.GoNext, FilePath=join_11)  # inputs Data: String, Write: Boolean, FilePath: String; same code as c_script

# ==== cluster Frames
rr_framestype = ClusterInput()
rr_rxoffset = ClusterInput()
rr_ryoffset = ClusterInput()
rr_rzoffset = ClusterInput()
rr_curves = ClusterInput()
rr_points = ClusterInput()
rr_mesh = ClusterInput()
rr_kinks = ClusterInput()
rr_lbf = ClusterInput()
rr_file = ClusterInput()
rr_framestype_2 = Integer(rr_framestype)
rr_rxoffset_2 = Integer(rr_rxoffset)
rr_ryoffset_2 = Integer(rr_ryoffset)
rr_rzoffset_2 = Integer(rr_rzoffset)
rr_curves_2 = Curve(rr_curves)
rr_points_2 = Point(rr_points)
rr_mesh_2 = Mesh(rr_mesh)
rr_kinks_2 = Boolean(rr_kinks)
rr_lbf_2 = Integer(rr_lbf)
rr_file_2 = FilePath(rr_file)
color = CSharpScript(Object=rr_curves_2)  # -> Color; inputs Object: Guid
# ---------- color: C# ----------
  if (Object == null)
  Color = System.Drawing.Color.Black;
  else
    Color = RhinoDocument.Objects.Find(Object).Attributes.ObjectColor;
# ---------- end color ----------

# ---- group: Divide curves
len = Length(Curve=rr_curves_2)
division = Division(A=len, B=rr_lbf_2)
round = Round(Number=division)  # -> Nearest, Floor, Ceiling
divide = DivideCurve(Curve=rr_curves_2, Count=round.Ceiling, Kinks=rr_kinks_2)  # -> simplify(Points), simplify(Tangents), Parameters

# ----
color_2 = ClusterOutput(color)

# ---- group: Curves tangent and mesh normal
meshcp = MeshClosestPoint(Point=divide.Points, Mesh=rr_mesh_2)  # -> Point, Index, Parameter
meval = MeshEval(Mesh=rr_mesh_2, Parameter=meshcp.Parameter)  # -> Point, Normal, Colour
mesh_normal = Vector(expr("-x", meval.Normal))
curve_tangent = Vector(divide.Tangents)

# ---- group: Dispatch
curves = StreamGate(Stream=divide.Points, Gate=rr_framestype_2)  # -> Target0, Target1, Target2, Target3
points = StreamGate(Stream=rr_points_2, Gate=rr_framestype_2)  # -> Target0, Target1, Target2, Target3, Target4
file = StreamGate(Stream=rr_file_2, Gate=rr_framestype_2)  # -> Target0, Target1, Target2, Target3, Target4, Target5

# ---- group: Read File
file_2 = ReadFile(File=file.Target5, PerLineParse=True)
split = TextSplit(Text=file_2, Separators=[" ", ","])
item = ListItem(List=split, Index=0, Wrap=True)  # -> Item, Item1, Item2, Item3, Item4, Item5
pt = ConstructPoint(XCoordinate=item.Item, YCoordinate=item.Item1, ZCoordinate=item.Item2)  # -> flatten(Point)
vec = VectorXYZ(XComponent=item.Item3, YComponent=item.Item4, ZComponent=item.Item5)  # -> flatten(Vector), Length
rev = Reverse(Vector=vec.Vector)
pl = PlaneNormal(Origin=pt, ZAxis=rev)
align = AlignPlane(Plane=pl, Direction=Vector(-1, 0, 0))  # -> Plane, Angle

# ---- group: Curve with tangent X and Rhino Z
pl_2 = PlaneNormal(Origin=curves.Target1, ZAxis=Vector(0, 0, -1))
align_2 = AlignPlane(Plane=pl_2, Direction=curve_tangent)  # -> Plane, Angle

# ---- group: Curve with Rhino X and mesh Z
pl_3 = PlaneNormal(Origin=curves.Target2, ZAxis=mesh_normal)
align_3 = AlignPlane(Plane=pl_3, Direction=Vector(-1, 0, 0))  # -> Plane, Angle

# ---- group: Curve with tangent X and mesh Z
pl_4 = PlaneNormal(Origin=curves.Target3, ZAxis=mesh_normal)
align_4 = AlignPlane(Plane=pl_4, Direction=curve_tangent)  # -> Plane, Angle

# ---- group: Curve with Rhino X and Rhino Z (or Points)
pl_5 = ConstructPlane(Origin=points.Target0, XAxis=Vector(-1, 0, 0), YAxis=Vector(0, 1, 0))

# ----
orienttargets = CSharpScript(
    InTargets=[pl_5, align_2.Plane, align.Plane, align_4.Plane, align_3.Plane],
    Rx=rr_rxoffset_2,
    Ry=rr_ryoffset_2,
    Rz=rr_rzoffset_2)  # -> Targets; inputs InTargets: Plane, Rx: Double, Ry: Double, Rz: Double
# ---------- orienttargets: C# ----------
    Rx = Rx * Math.PI / 180;
    Ry = Ry * Math.PI / 180;
    Rz = Rz * Math.PI / 180;
    Plane OutTargets = InTargets;
    OutTargets.Rotate(Rx, OutTargets.XAxis);
    OutTargets.Rotate(Ry, OutTargets.YAxis);
    OutTargets.Rotate(Rz, OutTargets.ZAxis);
    Targets = OutTargets;
# ---------- end orienttargets ----------
clean = CleanTree(RemoveNulls=True, RemoveInvalid=True, RemoveEmpty=True, Tree=orienttargets)
T = ClusterOutput(clean)
